# Grasshopper definition CurvedBeamOptimiser.gh (Grasshopper 1.0.8)
# plug-ins: Alpaca4d

# ---- group: 1 - The beam
starting_section = ValueList({"IPE300", "HEA500", "HEB300"}, selected="HEA500")
number_of_elements = Slider(30, range=4..80)
length_m = Slider(12, range=4..30)
rise_m = Slider(2.3, range=0..5)
second_support_at = Slider(0.11, range=0.05..0.95)
third_support_at = Slider(0.84, range=0.05..0.95)
load_at = Slider(0.69, range=0.05..1)
load_kn = Slider(50, range=0..200)

# ---- group: 2 - Geometry
panel = Panel("""0
0.65
0.45
0.45
1""")
# Section Optimiser: Curved beam - a Section Optimiser example.
# 
# A 12 m beam curves up and down in a vertical plane. It is built in at its start, held up at 15% and 33% of the way along, and free beyond: a continuous beam ending in a long cantilever, with 50 kN hanging near its far end and its own weight. It is cut into 30 elements, IPE300 in S355 to begin with.
# 
# 6 - Each element on its own. No design group: each element goes to the first section of the family it starts in - the IPEs for an IPE300 - that keeps it at or below MaxUtilisation, smallest area first. The beam grows over the third support, where the cantilever's moment is largest, and thins out towards the load and the built-in start. Switch the starting section to HEA300 and it stays among the HEAs.
# 
# 7 - One section for the whole beam: a design group over every element, from the list of IPEs in the panel, tried in the order it gives them.
# 
# Reshape the curve in the two panels of 2, and move the supports and the load with their sliders: each lands on the node nearest the fraction given. The top flange is held sideways every 0.5 m, wired into LengthLT in the Design menu; sized element by element, an unrestrained beam is only a rough guide, as lateral-torsional buckling belongs to the whole member.
panel_2 = Panel("""0
0.33
0.6
0.88
1""")
X = Expression(a=panel_2, L=length_m, Expression="a*L")
Z = Expression(h=panel, R=rise_m, Expression="h*R")
through = ConstructPoint(XCoordinate=X, YCoordinate=Z, ZCoordinate=0)
beam = Interpolate(Vertices=through, Degree=3, Periodic=False, KnotStyle=1)  # -> Curve, Length, Domain
nodes = DivideCurve(Curve=beam.Curve, Count=number_of_elements, Kinks=False)  # -> Points, Tangents, Parameters
pline = PolyLine(Vertices=nodes.Points, Closed=False)
elements = Explode(Curve=pline, Recursive=True)  # -> Segments, Vertices

# ----
geometry = Geometry(elements.Vertices)

load_node = Expression(t=load_at, n=number_of_elements, Expression="Round(t*n)")
downwards = Expression(P=load_kn, Expression="-P")
vector_xyz = VectorXYZ(XComponent=downwards, YComponent=0, ZComponent=downwards)  # -> Vector, Length
loaded = ListItem(List=geometry, Index=load_node, Wrap=True)
self_weight = GravityLoadAlpaca4d(Factor=1)
load = PointLoadAlpaca4d(Point=loaded, Force=vector_xyz.Vector, Moment=Vector(0, 0, 0))
load_pattern = LoadPatternAlpaca4d(Loads=[load, self_weight], Factor=1, mode="PlainPattern (Alpaca4d)")

support_nodes = Expression(t=[second_support_at, third_support_at], n=number_of_elements, Expression="Round(t*n)")
supported = ListItem(List=geometry, Index=support_nodes, Wrap=True)
start = ListItem(List=geometry, Index=0, Wrap=True)
held = BooleanToggle(True)
free = BooleanToggle(False)
held_up = SupportAlpaca4d(Position=supported, Tx=free, Ty=free, Tz=held, Rx=free, Ry=free, Rz=free)
built_in = SupportAlpaca4d(Position=start, Tx=held, Ty=held, Tz=held, Rx=held, Ry=held, Rz=held)

list_length = ListLength(List=elements.Segments)
series = Series(Start=0, Step=1, Count=list_length)
material_library_elastic_alpaca4d = MaterialLibraryElasticAlpaca4d(
    MaterialPresetElastic_Grade="S355",
    MaterialPresetElastic_Model="Uniaxial",
    MaterialPresetElastic_Type="Steel",
    menu=[dropdown(0), dropdown(3), dropdown(0)])
range = Range(Domain="0.05 to 0.30", Steps=10)
concatenate = Concatenate(FragmentA=range)
circlecs_alpaca4d = CircleCSAlpaca4d(SectionName=range, Diameter=range, Thickness="0.005", Material=material_library_elastic_alpaca4d)
maxutilisation = Slider(1, range=0.5..1)
design_group_alpaca4d = DesignGroupAlpaca4d(ElementId="Beam*", Sections=circlecs_alpaca4d)

# ---- group: 3 - Member
material_library_elastic = MaterialLibraryElasticAlpaca4d(
    MaterialPresetElastic_Grade="S355",
    MaterialPresetElastic_Model="Uniaxial",
    MaterialPresetElastic_Type="Steel",
    menu=[dropdown(0), dropdown(3), dropdown(0)])
starting_section_2 = SteelSectionLibraryAlpaca4d(
    SectionName=starting_section,
    Material=material_library_elastic,
    SectionLibrary_Family="I",
    SectionLibrary_Section="HEA500",
    menu=[dropdown(0), dropdown(18)])
panel_3 = Panel("Beam")

# ----
concatenate_2 = Concatenate(FragmentA=panel_3, FragmentB=series)

# ---- group: 3 - Member (continued)
forcebeamcolumn = ForceBeamColumnAlpaca4d(
    Line=flatten(elements.Segments),
    Section=starting_section_2,
    Colour=RGB(1, 30, 254),
    ElementId=concatenate_2,
    mode="ForceBeamColumn (Alpaca4d)")

# ---- group: 5 - Model
assemble_model = AssembleModelAlpaca4d(Elements=forcebeamcolumn, Supports=[built_in, held_up], LoadPatterns=flatten(load_pattern), Tolerance=0.01)  # -> AlpacaModel, Mass

# ----
each_element = SectionOptimiserAlpaca4d(
    AlpacaModel=assemble_model.AlpacaModel,
    DesignGroups=design_group_alpaca4d,
    MaxUtilisation=maxutilisation,
    Iterations="20",
    Fabrication="Rolled",
    ΓM0=1,
    ΓM1=1,
    System="BandSPD",
    Algorithm="Newton")  # -> AlpacaModel, Section, Utilisation, Element, Mass, Converged, Governing, Group, History, Log
panel_4 = Panel(each_element.Mass)
panel_5 = Panel(each_element.Section)
model_view_alpaca4d = ModelViewAlpaca4d(AlpacaModel=each_element.AlpacaModel)
view_results_wip_alpaca4d = ViewResults_WIPAlpaca4d(AlpacaModel=model_view_alpaca4d, Step=0, BeamStressSigmaX=1, ResultMenuOrder=1, ResultUnits=1)  # -> Info, Values, Colors
